# Dynamo graph BIG_CenterAreaTags.dyn "Area Tags" (Dynamo 2.12.1.8246)

# group: B. Chose option: 1. Keep Area location | Move Tag to same point 2. Keep Area location | Move Tag to geometrical center 3. Move Area + Tag location to gemetrical center
a_process_only_room_tags_in = BoolSelector(false)  # "A. Process only Room Tags in warnings"; graph input
b_chose_option_1_keep_area = DoubleSlider(3, range=1..3 step 1)  # "B. Chose option: 1. Keep Area location | Move Tag to same point 2. Keep Area location | Move Tag to geometrical center 3. Move Area + Tag location to gemetrical center"; graph input

python_script = Python(IN[0]=a_process_only_room_tags_in)  # IronPython2
# ---------- python_script.python (55 lines) ----------
# Load the Python Standard and DesignScript Libraries
import clr
import sys
import os.path
from datetime import datetime
from System import Environment
sys.path.append('C:\Program Files (x86)\IronPython 2.7\Lib')
import System
from System import Array
from System.Collections.Generic import *
clr.AddReference('ProtoGeometry')
from Autodesk.DesignScript.Geometry import *
clr.AddReference("RevitNodes")
import Revit
clr.ImportExtensions(Revit.Elements)
clr.ImportExtensions(Revit.GeometryConversion)
clr.AddReference("RevitServices")
import RevitServices
from RevitServices.Persistence import DocumentManager 
from RevitServices.Transactions import TransactionManager 

clr.AddReference("RevitAPI")
clr.AddReference("RevitAPIUI")

import Autodesk 
from Autodesk.Revit.DB import *
from Autodesk.Revit.UI import *
import time

doc = DocumentManager.Instance.CurrentDBDocument
uiapp = DocumentManager.Instance.CurrentUIApplication 
app = uiapp.Application 
uidoc = uiapp.ActiveUIDocument

### NOW LIFT WHAT THOUSANDS CAN'T SHIFT ### 

isolate_war = IN[0]

if isolate_war:
	war_area_tag_ids, war_areas = [], []
	warnings = doc.GetWarnings()
	for w in warnings:
		if "Area Tag is outside of its Area." in w.GetDescriptionText():
			ids = w.GetFailingElements()
			for i in ids:
				war_area_tag_ids.Add(i)
	war_tags = [doc.GetElement(i) for i in war_area_tag_ids]
	war_areas = [i.Area for i in war_tags]
	OUT = war_tags, war_areas

else:
	tags = FilteredElementCollector(doc).OfCategory(BuiltInCategory.OST_AreaTags).WhereElementIsNotElementType().ToElements()
	areas = [i.Area for i in tags]
	OUT = tags, areas
	
# ----------------------------------------
code_block = CodeBlock(tags=python_script, areas=python_script) { tags[0]; areas[1]; }
python_script_2 = Python(IN[0]=code_block.out0, IN[1]=code_block.out1, IN[2]=b_chose_option_1_keep_area)  # IronPython2
# ---------- python_script_2.python (106 lines) ----------
import clr
import sys
import os.path
from System import Environment
sys.path.append('C:\Program Files (x86)\IronPython 2.7\Lib')
import System
from System import Array
from System.Collections.Generic import *
clr.AddReference('ProtoGeometry')
from Autodesk.DesignScript.Geometry import (Geometry, Point as pt)
clr.AddReference("RevitNodes")
import Revit
clr.ImportExtensions(Revit.Elements)
clr.ImportExtensions(Revit.GeometryConversion)
clr.AddReference("RevitServices")
import RevitServices
from RevitServices.Persistence import DocumentManager 
from RevitServices.Transactions import TransactionManager 
clr.AddReference("RevitAPI")
clr.AddReference("RevitAPIUI")
import Autodesk 
from Autodesk.Revit.DB import *
from Autodesk.Revit.UI import *

doc = DocumentManager.Instance.CurrentDBDocument
uiapp = DocumentManager.Instance.CurrentUIApplication 
app = uiapp.Application 
uidoc = uiapp.ActiveUIDocument

### NOW LIFT WHAT THOUSANDS CAN'T SHIFT ###

tags = 	UnwrapElement(IN[0])
areas = UnwrapElement(IN[1])
opt = 	IN[2]

# GET AREA CENTER
def get_center(area):
    # Get the Area Boundary segments
    sp_options = SpatialElementBoundaryOptions()
    bound_segments = area.GetBoundarySegments(sp_options)

    # Calculate the centroid point
    total_len = 0
    centroid_x = 0
    centroid_y = 0

    for segments in bound_segments:
        for boundary_segment in segments:
            curve = boundary_segment.GetCurve()
            
            centroid_x += curve.GetEndPoint(0).X * curve.Length
            centroid_y += curve.GetEndPoint(0).Y * curve.Length
            total_len += curve.Length

    if total_len != 0:
        centroid_x /= total_len
        centroid_y /= total_len
        
    elevation = area.Level.Elevation * 304.8

    return XYZ(centroid_x, centroid_y, elevation)

# CENTER THE AREAS
def center_areas(areas):
    count = 0
    for area in areas:
        try:
            center = get_center(area)
            current = area.Location.Point # get current element location
            # MOVE THE AREA TO THE NEW LOCATION
            area.Location.Move(center - current)
            count += 1
        except:
            continue
    return count
    
# ALIGN THE TAGS
def align_tags(tags, to_center): 
    count = 0
    for tag in tags:
        current_loc = tag.Location.Point
        if to_center:
            new_loc = get_center(tag.Area)
        else:
            new_loc = tag.Area.Location.Point
        tag.Location.Move(new_loc - current_loc)
        count += 1
    return count
    

TransactionManager.Instance.EnsureInTransaction(doc)

if opt == 1:
    result = align_tags(tags, False)
elif opt == 2:
    result = align_tags(tags, True)
elif opt == 3:
    center_areas(areas)
    result = align_tags(tags, False)   

TransactionManager.Instance.TransactionTaskDone()

if result > 0:
	OUT = str(result) + " Area Tags was/were moved."
else:
	OUT = "No Area Tags were moved."
# ----------------------------------------
result = Watch(python_script_2)  # graph output
