# Dynamo graph BIG_CenterRoomTags.dyn "Room Tags" (Dynamo 2.12.1.8246)

# group: B. Chose option: 1. Keep Room location | Move Tag to same point 2. Keep Room location | Move Tag to geometrical center 3. Move Room + Tag location to gemetrical center
a_process_only_room_tags_in = BoolSelector(false)  # "A. Process only Room Tags in warnings"; graph input
b_chose_option_1_keep_room = DoubleSlider(2, range=1..3 step 1)  # "B. Chose option: 1. Keep Room location | Move Tag to same point 2. Keep Room location | Move Tag to geometrical center 3. Move Room + Tag location to gemetrical center"; graph input

python_script = Python(IN[0]=a_process_only_room_tags_in)  # IronPython2
# ---------- python_script.python (57 lines) ----------
# Load the Python Standard and DesignScript Libraries
import clr
import sys
import os.path
from datetime import datetime
from System import Environment
sys.path.append('C:\Program Files (x86)\IronPython 2.7\Lib')
import System
from System import Array
from System.Collections.Generic import *
clr.AddReference('ProtoGeometry')
from Autodesk.DesignScript.Geometry import *
clr.AddReference("RevitNodes")
import Revit
clr.ImportExtensions(Revit.Elements)
clr.ImportExtensions(Revit.GeometryConversion)
clr.AddReference("RevitServices")
import RevitServices
from RevitServices.Persistence import DocumentManager 
from RevitServices.Transactions import TransactionManager 

clr.AddReference("RevitAPI")
clr.AddReference("RevitAPIUI")

import Autodesk 
from Autodesk.Revit.DB import *
from Autodesk.Revit.UI import *
import time

doc = DocumentManager.Instance.CurrentDBDocument
uiapp = DocumentManager.Instance.CurrentUIApplication 
app = uiapp.Application 
uidoc = uiapp.ActiveUIDocument


isolate_war = IN[0]




if isolate_war:
	war_room_tag_ids, war_rooms = [], []
	warnings = doc.GetWarnings()
	for w in warnings:
		if "Room Tag is outside of its Room." in w.GetDescriptionText():
			ids = w.GetFailingElements()
			for i in ids:
				war_room_tag_ids.Add(i)
	war_tags = [doc.GetElement(i) for i in war_room_tag_ids]
	war_rooms = [i.Room for i in war_tags]
	OUT = war_tags, war_rooms

else:
	tags = FilteredElementCollector(doc).OfCategory(BuiltInCategory.OST_RoomTags).WhereElementIsNotElementType().ToElements()
	rooms = [i.Room for i in tags]
	OUT = tags, rooms
	
# ----------------------------------------
code_block = CodeBlock(tags=python_script, rooms=python_script) { tags[0]; rooms[1]; }
python_script_2 = Python(IN[0]=code_block.out0, IN[1]=code_block.out1, IN[2]=b_chose_option_1_keep_room)  # IronPython2
# ---------- python_script_2.python (101 lines) ----------
import clr
import sys
import os.path
from System import Environment
sys.path.append('C:\Program Files (x86)\IronPython 2.7\Lib')
import System
from System import Array
from System.Collections.Generic import *
clr.AddReference('ProtoGeometry')
from Autodesk.DesignScript.Geometry import (Geometry, Point as pt)
clr.AddReference("RevitNodes")
import Revit
clr.ImportExtensions(Revit.Elements)
clr.ImportExtensions(Revit.GeometryConversion)
clr.AddReference("RevitServices")
import RevitServices
from RevitServices.Persistence import DocumentManager 
from RevitServices.Transactions import TransactionManager 
clr.AddReference("RevitAPI")
clr.AddReference("RevitAPIUI")
import Autodesk 
from Autodesk.Revit.DB import *
from Autodesk.Revit.UI import *

doc = DocumentManager.Instance.CurrentDBDocument
uiapp = DocumentManager.Instance.CurrentUIApplication 
app = uiapp.Application 
uidoc = uiapp.ActiveUIDocument

### NOW LIFT WHAT THOUSANDS CAN'T SHIFT ###

tags = UnwrapElement(IN[0])
rooms = UnwrapElement(IN[1])
opt = IN[2]

count_tags = 0
count_rooms = 0

# GET ROOM CENTER
def get_center(room):
	# level elevation - unit millimeter 
    elevation = room.Level.Elevation * 304.8
    # get enumerator to loop geo-objects
    geoobj = room.GetGeometryObjectFromReference(Reference(room)).GetEnumerator()
    for obj in geoobj:
      	room_geometry = obj.ToProtoType()
        point = room_geometry.Centroid()
        center = point.ByCoordinates(point.X, point.Y, elevation)
        break
    return center.ToXyz()

# CENTER THE ROOMS
def center_rooms(rooms):
    count = 0
    for room in rooms:
        try:
            # level elevation - unit millimeter 
            elevation = room.Level.Elevation * 304.8
            # get enumerator to loop geo-objects
            geoobj = room.GetGeometryObjectFromReference(Reference(room)).GetEnumerator()
            # loop geo-object
            for obj in geoobj:
                # convert to dynamo type
                room_geometry = obj.ToProtoType()
                point = room_geometry.Centroid()
                center = point.ByCoordinates(point.X, point.Y, elevation) # create location point with level elevation
                current = room.Location.Point # get current element location
                # MOVE THE ROOM TO THE NEW LOCATION
                room.Location.Move(center.ToXyz() - current)
                count += 1
        except:
            continue
    return count
    
# ALIGN THE TAGS
def align_tags(tags, to_center): 
    count = 0
    for tag in tags:
    	current_loc = tag.Location.Point
    	if to_center:
    		new_loc = get_center(tag.Room)
    	else:
            new_loc = tag.Room.Location.Point
        tag.Location.Move(new_loc - current_loc)
        count += 1
    return count
    

TransactionManager.Instance.EnsureInTransaction(doc)

if opt == 1:
    result = align_tags(tags, False)
elif opt == 2:
    result = align_tags(tags, True)
elif opt == 3:
    center_rooms(rooms)
    result = align_tags(tags, False)   

TransactionManager.Instance.TransactionTaskDone()

OUT = result + " Rooms Tags were moved."
# ----------------------------------------
result = Watch(python_script_2)  # graph output
