# Dynamo graph Batch Export IFC.dyn (Dynamo 2.12.1.8246)
# packages: Rhythm 2021.1.1, Genius Loci 2021.2.3

rvt_models_folder_path_input = CodeBlock { "C:\\_Work\\BIG\\Open and export IFC"; }
code_block = CodeBlock { ""; false; }
python_script = Python(IN[0]=rvt_models_folder_path_input, IN[2]=code_block.out1)  # IronPython2; unwired: IN[1]
# ---------- python_script.python (81 lines) ----------
import clr
import sys
import os
#import linq
sys.path.append('C:\Program Files (x86)\IronPython 2.7\Lib')
import System
from System import Array
from System.Collections.Generic import *
clr.AddReference('ProtoGeometry')
from Autodesk.DesignScript.Geometry import *
clr.AddReference("RevitNodes")
import Revit
clr.ImportExtensions(Revit.Elements)
clr.ImportExtensions(Revit.GeometryConversion)
clr.AddReference("RevitServices")
import RevitServices
from RevitServices.Persistence import DocumentManager 
from RevitServices.Transactions import TransactionManager 

clr.AddReference("RevitAPI")
clr.AddReference("RevitAPIUI")

import Autodesk 
from Autodesk.Revit.DB import *
from Autodesk.Revit.UI import *



####### NOW LIFT WHAT THOUSANDS CAN'T SHIFT ########

dir_path = IN[0]
filter = IN[1]
if filter == None:
    filter = ""
subfolders = IN[2]



def open_RVT_file(file_path):
    # create open options
    open_options = OpenOptions()
    open_options.Audit = False    
    # open the Revit model
    revit_doc = DocumentManager.Instance.CurrentDBDocument
    if revit_doc:
        revit_app = revit_doc.Application
        model_path = ModelPathUtils.ConvertUserVisiblePathToModelPath(file_path)
        new_doc = revit_app.OpenDocumentFile(model_path, open_options)
        return new_doc
    else:
        return None

def get_3D_view(doc):
    views = FilteredElementCollector(doc).OfClass(View3D).WhereElementIsNotElementType().ToElements()
    for view in views:
        if view.ViewType == ViewType.ThreeD and view.IsTemplate != True and view != None:
            def_3d_view = view
            break
    return def_3d_view

# get the RVT files
rvt_files = []
if subfolders == True:
    for root, dirs, files in os.walk(dir_path):
        for file in files and filter in file:
            if file.endswith(".rvt") and filter in file:
                rvt_files.append(os.path.join(root, file))
else:
    for file in os.listdir(dir_path):
        if file.endswith(".rvt") and filter in file:
            rvt_files.append(os.path.join(dir_path, file))
                
docs, views, titles = [], [], []

for path in rvt_files:
    doc = open_RVT_file(path)
    docs.append(doc)
    views.append(get_3D_view(doc))
    titles.append(doc.Title)
    
OUT = docs, views, titles
# ----------------------------------------
code_block_2 = CodeBlock(docs=python_script, views=python_script, titles=python_script) { docs[0]; views[1]; titles[2]; }
ifc_models_folder_path_output = CodeBlock { "C:\\_Work\\BIG\\Open and export IFC\\_IFC"; }
code_block_3 = CodeBlock { "IFC2x3"; "0"; }
code_block_4 = CodeBlock { false; }
export_ifc_in_document = Custom[Export IFC in Document](document=code_block_2.out0, DirectoryPath=ifc_models_folder_path_output, view=code_block_2.out1, Filename=code_block_2.out2, IFCversion=code_block_3.out0, ProjectOrigin=code_block_3.out1, WallAndColumnSplitting=code_block_4, ExportBaseQuantities=code_block_4)  # package Genius Loci; Export Views to IFC file from document. The Project Origin option works only with Revit 2018 and above. Some other IFC options are embedded inside the python script.
python_script_2 = Python(IN[0]=python_script, IN[1]=ifc_models_folder_path_output)  # IronPython2; frozen
# ---------- python_script_2.python (49 lines) ----------
import clr
import sys
#import linq
sys.path.append('C:\Program Files (x86)\IronPython 2.7\Lib')
import System
from System import Array
from System.Collections.Generic import *
clr.AddReference('ProtoGeometry')
from Autodesk.DesignScript.Geometry import *
clr.AddReference("RevitNodes")
import Revit
clr.ImportExtensions(Revit.Elements)
clr.ImportExtensions(Revit.GeometryConversion)
clr.AddReference("RevitServices")
import RevitServices
from RevitServices.Persistence import DocumentManager 
from RevitServices.Transactions import TransactionManager 

clr.AddReference("RevitAPI")
clr.AddReference("RevitAPIUI")

import Autodesk 
from Autodesk.Revit.DB import *
from Autodesk.Revit.UI import *



####### NOW LIFT WHAT THOUSANDS CAN'T SHIFT ########

docs = UnwrapElement(IN[0])
folder = IN[1]

lst_3d_views = []
titles = []

def get_3D_view(doc):
    views = FilteredElementCollector(doc).OfClass(View3D).WhereElementIsNotElementType().ToElements()
    for view in views:
        if view.ViewType == ViewType.ThreeD and view.IsTemplate != True and view != None:
            def_3d_view = view
            break
    return def_3d_view

# ITERATE THROUGH THE DOCUMENTS
for doc in docs:
    lst_3d_views.append(get_3D_view(doc))
    titles.append(doc.Title)
        
OUT = lst_3d_views, titles
# ----------------------------------------
code_block_5 = CodeBlock(x=python_script_2) { views =			 x[0]; }
code_block_6 = CodeBlock(dir=ifc_models_folder_path_output) { _dir; }
code_block_7 = CodeBlock(x=python_script_2) { file_names =	 x[1]; }
directory_from_path = DirectoryObject(path=rvt_models_folder_path_input)
getDirectoryContents = FileSystem.GetDirectoryContents(directory=directory_from_path)
ʳʰʸᵗʰᵐ_applications = Rhythm.Revit.Application.Applications.OpenDocumentFile(filePath=getDirectoryContents.files)
code_block_8 = CodeBlock(doc=ʳʰʸᵗʰᵐ_applications) { _doc; }
