# Dynamo graph Create Walls Spec Views.dyn (Dynamo 2.19.3.6394)
# packages: Genius Loci 2021.2.3, Data-Shapes 2021.2.92, archi-lab.net 2021.25.2521, ACG Tools 0.1.1, archi-lab.net 2022.210.2522, Clockwork for Dynamo 1.x 1.0.3, Rhythm 2021.1.1, SteamNodes 1.2.4

# group: Process the walls from the host model

# group: Dimension wall layers

# group: Annotate wall layers - material tags

# group: Annotate wall instances

# group: Create wall instance for the specification view

# group: Select Elements
# Get the active view and it's level.
python_script = Python()  # CPython3
# ---------- python_script.python (34 lines) ----------
import clr
import sys
sys.path.append('C:\Program Files (x86)\IronPython 2.7\Lib')
import System
from System import Array
from System.Collections.Generic import *
clr.AddReference('ProtoGeometry')
from Autodesk.DesignScript.Geometry import *
clr.AddReference("RevitNodes")
import Revit
clr.ImportExtensions(Revit.Elements)
clr.ImportExtensions(Revit.GeometryConversion)
clr.AddReference("RevitServices")
import RevitServices
from RevitServices.Persistence import DocumentManager 
from RevitServices.Transactions import TransactionManager 

clr.AddReference("RevitAPI")
clr.AddReference("RevitAPIUI")

import Autodesk 
from Autodesk.Revit.DB import *
from Autodesk.Revit.UI import *

doc = DocumentManager.Instance.CurrentDBDocument
uiapp = DocumentManager.Instance.CurrentUIApplication 
app = uiapp.Application 
uidoc = uiapp.ActiveUIDocument

#######OK NOW YOU CAN CODE########

view = doc.ActiveView

OUT = view, view.GenLevel
# ----------------------------------------
code_block = CodeBlock(x=python_script) { active_view = x[0]; level = x[1]; }

# group: Select Elements
code_block_2 = CodeBlock { true; }

# group: Input
code_block_3 = CodeBlock { "Note:"; }
string = StringInput("""This tool can generate Wall spec elements in the active view.
To run the tool, you need to create a dedicated view and place a line to define the origin for generating the elements. Make sure all required Wall and Material tags are present in the model.
The tool will detect all wall types already placed and visible in the view and ignore them.
Please fill in the required fields below and click "Generate Elements". Select the a line once the window disappears.
Please remember, that this tool is only as good as the data you are inputting!
For more information on how this tool works, please refer to the Revit Tutorials channel in MS Teams.""")
# note: Custom Node: Data-Shapesv.2022.2.106
textnote_data = Custom[TextNote Data](Title=code_block_3, TextNote=string)  # package Data-Shapes; Create Data for TextNote input in UI.MultipleInputForm ++ . Check out www.data-shapes.net for more informations

# group: Input
code_block_4 = CodeBlock { "Type parameter name to filter:"; "Type Mark"; }
# note: Custom Node: Data-Shapesv.2022.2.106
textbox_data = Custom[TextBox Data](InputName=code_block_4.out0, DefaultText=code_block_4.out1)  # package Data-Shapes; Create Data for TextBox input in UI.MultipleInputForm ++ . Check out www.data-shapes.net for more informations
code_block_5 = CodeBlock { "Parameter value must contain:"; }
textbox_data_2 = Custom[TextBox Data](InputName=code_block_5)

# group: Input
# Get all wall and material tag types (already used in the model)
code_block_6 = CodeBlock { "Select material tag type"; "Select wall tag type"; }
python_script_2 = Python()  # CPython3
# ---------- python_script_2.python (56 lines) ----------
import clr
import sys
sys.path.append('C:\Program Files (x86)\IronPython 2.7\Lib')
import System
from System import Array
from System.Collections.Generic import *
clr.AddReference('ProtoGeometry')
from Autodesk.DesignScript.Geometry import *
clr.AddReference("RevitNodes")
import Revit
clr.ImportExtensions(Revit.Elements)
clr.ImportExtensions(Revit.GeometryConversion)
clr.AddReference("RevitServices")
import RevitServices
from RevitServices.Persistence import DocumentManager 
from RevitServices.Transactions import TransactionManager 

clr.AddReference("RevitAPI")
clr.AddReference("RevitAPIUI")

import Autodesk 
from Autodesk.Revit.DB import *
from Autodesk.Revit.UI import *

doc = DocumentManager.Instance.CurrentDBDocument
uiapp = DocumentManager.Instance.CurrentUIApplication 
app = uiapp.Application 
uidoc = uiapp.ActiveUIDocument

#######OK NOW YOU CAN CODE########

view = doc.ActiveView

# get all family types in the model
fam_types = FilteredElementCollector(doc)\
.OfClass (FamilySymbol).ToElements()

mat_tag_types, wall_tag_types = [], []
mat_tag_names, wall_tag_names = [], []


a,b,c = [], [], []

for t in fam_types:
    cat = t.Category.Name
    fam_name = t.Family.Name
    type_name = t.get_Parameter(BuiltInParameter.SYMBOL_NAME_PARAM)\
    .AsValueString()
    if cat == "Material Tags":
        mat_tag_types.append(t)
        mat_tag_names.append(fam_name + " : " + type_name)
    elif cat == "Wall Tags" or cat == "Multy-Category Tags":
        wall_tag_types.append(t)
        wall_tag_names.append(fam_name + " : " + type_name)

OUT = mat_tag_types, mat_tag_names, wall_tag_types, wall_tag_names
# ----------------------------------------
code_block_7 = CodeBlock(x=python_script_2) { mat_tags = x[0]; mat_tags_names = x[1]; wall_tags = x[2]; wall_tags_names = x[3]; }
# note: Custom Node: Data-Shapesv.2022.2.106
dropdown_data = Custom[DropDown Data](InputName=code_block_6.out0, Keys=code_block_7.mat_tags_names, Values=code_block_7.mat_tags)  # package Data-Shapes; Create data for DropDown input in UI.MultiInputForm ++ . Check out www.data-shapes.net for more infos.
dropdown_data_2 = Custom[DropDown Data](InputName=code_block_6.out1, Keys=code_block_7.wall_tags_names, Values=code_block_7.wall_tags)

# group: Input
code_block_8 = CodeBlock { "Select spacing between material tags"; 30; 200; 60; 5; }
# note: Custom Node: Data-Shapesv.2022.2.106
slider = Custom[Slider](InputName=code_block_8.out0, Minimum=code_block_8.out1, Maximum=code_block_8.out2, Default_Value=code_block_8.out3, Step=code_block_8.out4)  # package Data-Shapes; Creates slider input for UI.MultipleInputForm ++ . Set the step to decimal value if you want a double slider, or to a integer value if you want an integer slider.
code_block_9 = CodeBlock { "Generate dimensions"; }
boolean_input = Custom[Boolean input](InputName=code_block_9)  # package Data-Shapes; Creates a boolean input for UI.MultipleInputForm ++ . Check out www.data-shapes.net for more infos!

# group: Input
code_block_10 = CodeBlock { true; "Generate Elements"; "Cancel"; false; 800; 400; }
list_create = List.Create(item0=textnote_data, item1=textbox_data, item2=textbox_data_2, item3=dropdown_data, item4=dropdown_data_2, item5=slider, item6=boolean_input)
# note: Custom Node: Data-Shapesv.2022.2.106
multipleinputform = Custom[MultipleInputForm ++](ButtonText_optional=code_block_10.out1, Inputs=list_create, Toggle=code_block_10.out0, CancelButtonText_optional=code_block_10.out2, Width_optional=code_block_10.out4, LabelWidth_optional=code_block_10.out5)  # package Data-Shapes; Create a form with multiple inputs. see www.data-shapes.net for tutorials and infos!

# group: Control
end = Revit.Transaction.Transaction.End(input=multipleinputform.User_Inputs)
start = Revit.Transaction.Transaction.Start(input=end)

# group: Control
list_create_2 = List.Create(item0=code_block_2, item1=start)
code_block_11 = CodeBlock(x=list_create_2) { x[0]; }

categories = Categories("OST_Lines")

# group: Control
list_create_3 = List.Create(item0=categories, item1=start)
code_block_12 = CodeBlock(x=list_create_3) { x[0]; }

# group: Input
# note: Custom Node: Rhythmv.2023.7.3
ʳʰʸᵗʰᵐ_selection_pick = Rhythm.Revit.Selection.Selection.Pick(runIt=code_block_11, category=code_block_12, singleSelection=code_block_11)
code_block_13 = CodeBlock(x=start) { parameterName=x[0]; parameterValue=x[1]; materialTag=x[2]; wallTag=x[3]; tagSpacing=x[4]; withDimensions=x[5]; }

# group: Select Elements
# note: 1. Get all wall types already existing in the mode.
# 2. Get all wall types already existing in the active view.
# 3. Select only wall types that are not existing in the actve view and that contain the given string as a value of a given parameter.
python_script_3 = Python(IN[0]=multipleinputform.Was_Cancelled, IN[1]=code_block_13.parameterName, IN[2]=code_block_13.parameterValue)  # CPython3
# ---------- python_script_3.python (77 lines) ----------
import clr
import sys
sys.path.append('C:\Program Files (x86)\IronPython 2.7\Lib')
import System
from System import Array
from System.Collections.Generic import *
clr.AddReference('ProtoGeometry')
from Autodesk.DesignScript.Geometry import *
clr.AddReference("RevitNodes")
import Revit
clr.ImportExtensions(Revit.Elements)
clr.ImportExtensions(Revit.GeometryConversion)
clr.AddReference("RevitServices")
import RevitServices
from RevitServices.Persistence import DocumentManager 
from RevitServices.Transactions import TransactionManager 

clr.AddReference("RevitAPI")
clr.AddReference("RevitAPIUI")

import Autodesk 
from Autodesk.Revit.DB import *
from Autodesk.Revit.UI import *

doc = DocumentManager.Instance.CurrentDBDocument
uiapp = DocumentManager.Instance.CurrentUIApplication 
app = uiapp.Application 
uidoc = uiapp.ActiveUIDocument

cancelled = IN[0]
param_name = str(IN[1])
param_val = str(IN[2])

#######OK NOW YOU CAN CODE########

if cancelled:
    OUT = []
else:

    view = doc.ActiveView

    # get all walls in the active view
    v_walls = FilteredElementCollector(doc, view.Id)\
    .OfCategory(BuiltInCategory.OST_Walls)\
    .WhereElementIsNotElementType().ToElements()
# get all unique wall types in the active view
    v_type_ids = []
    for w in v_walls:
        if w.GetTypeId() in v_type_ids:
            continue
        else:
            v_type_ids.append(w.GetTypeId())

# get all walls in the model
    walls = FilteredElementCollector(doc)\
    .OfCategory(BuiltInCategory.OST_Walls)\
    .WhereElementIsNotElementType().ToElements()

# get all unique wall types
    types, type_ids = [], []
    for w in walls:
        if w.GetTypeId() in type_ids or w.GetTypeId() in v_type_ids:
            continue
        else:
            type_ids.append(w.GetTypeId())
            types.append(w.WallType)

#filter the wall types by a given parameter
    valid_types = []
    for t in types:
        try:
            if param_val in t.LookupParameter(param_name).AsString():
                valid_types.append(t)
        except:
            continue

    OUT = valid_types
# ----------------------------------------

# group: Control
# Sort the wall types by their Type Mark values
code_block_14 = CodeBlock(walls=python_script_3) { walls; walls.GetParameterValueByName("Type Mark"); }
sortByKey = List.SortByKey(list=code_block_14.walls, keys=code_block_14.out1)

# group: Process
# Create staring points for all the spec wall pieces
geometry = Element.Geometry(element=ʳʰʸᵗʰᵐ_selection_pick)
code_block_15 = CodeBlock(ln=geometry) { pt = ln.StartPoint; trans_point = pt.Translate(400,-300,0); trans_point.X; trans_point.Y; trans_point.Z; }
code_block_16 = CodeBlock(walls=sortByKey.sortedList)
# ---------- code_block_16.designscript (9 lines) ----------
count = DSCore.List.Count(walls);

rows = count/4;
rows_ttl = DSCore.Math.Ceiling(rows);

(0..3)*1750;
(0..(rows_ttl-1))*1350;

leftover = (rows_ttl*4-count)*-1;
# ----------------------------------------
# note: X coordinate for each columns
add = code_block_15.out2 + code_block_16.out3  # lacing=Longest
# note: Y coordinate for each row
sub = code_block_15.out3 - code_block_16.out4  # lacing=Longest
byCoordinates = Point.ByCoordinates(x=add, y=sub, z=code_block_15.out4, lacing=CrossProduct)
flatten = List.Flatten(list=byCoordinates)
Y = Point.Y()  # unwired: point
groupByFunction = List.GroupByFunction(list=flatten, groupFunction=Y)
X = Point.X()  # unwired: point
sortByFunction = List.SortByFunction(list=groupByFunction@L2, sortFunction=X)
# note: Generate starting points for the wall instances
code_block_17 = CodeBlock(lst=sortByFunction, amnt=code_block_16.leftover) { pts = DSCore.List.Flatten(lst); DSCore.List.DropItems(pts, amnt); }
code_block_18 = CodeBlock(amnt=code_block_16.count)  # unwired: ptZ
# ---------- code_block_18.designscript (3 lines) ----------
// Z coordinate for each wall type
zs = DSCore.List.OfRepeatedItem(ptZ, amnt);
DSCore.List.Flatten(zs);
# ----------------------------------------

# group: Input
code_block_19 = CodeBlock { 1350; }
code_block_20 = CodeBlock { -850; }
code_block_21 = CodeBlock(verticalDisttanceBetweenWallPieces=code_block_19, wallPiecesLength=code_block_20) { verticalDisttanceBetweenWallPieces; wallPiecesLength; halfLength=wallPiecesLength/2; }

# group: Process
# Create end points for all the spec wall pieces
translate = Geometry.Translate(geometry=code_block_17.out1, yTranslation=code_block_21.wallPiecesLength)

watch = Watch(code_block.level)
watch_2 = Watch(sortByKey.sortedList)

# group: Python | Important
# Create placeholder spec wall pieces
code_block_22 = CodeBlock(start_pts=code_block_17.out1, end_pts=translate) { 3000; Line.ByStartPointEndPoint(start_pts, end_pts); }

watch_3 = Watch(code_block_22.out0)

# group (continued): Python | Important
# note: Create wall instances
byCurveAndHeight = Wall.ByCurveAndHeight(curve=code_block_22.out1, height=watch_3, level=watch, wallType=watch_2)
end_2 = Revit.Transaction.Transaction.End(input=byCurveAndHeight)

# group: Processing
# note: Custom Node: ACG Toolsv.0.1.1
elements_get_types = Custom[Elements.Get Types](elements=end_2)  # package ACG Tools; Gets types from given elements, including linked elements too. Taken from Clockworks
elements_compound_structure = Custom[Elements.Compound Structure Layers](elements_type=elements_get_types)  # package ACG Tools; From Clockworks. Widths not working in mm
code_block_23 = CodeBlock(value=elements_compound_structure.widths) { value==0?null:value; }
# note: remove any 0 layers
# note: Custom Node: archilab
clear_list = Custom[Clear List](input=code_block_23)  # package archi-lab.net; This node will remove all Null and Empty Lists from any list.
# note: external face of wall line (-1mm)
code_block_24 = CodeBlock(walls=end_2, wall_types=elements_get_types)
# ---------- code_block_24.designscript (8 lines) ----------
walls;
wall_types;

widths = wall_types.GetParameterValueByName("Width");
half_widths = (widths/2)-1;
locations = walls.GetLocation();
curves = locations.Translate(half_widths,0,0);
start_pts = curves.StartPoint;
# ----------------------------------------

# group: Processing
count = List.Count(list=clear_list@@L2)
code_block_25 = CodeBlock { 0; }
# note: Custom Node: Clockwork
dropLastItem = Custom[List.DropLastItem](list=clear_list@L2)  # package Clockwork for Dynamo 1.x; Drops the last item from a given list.
addItemToFront = List.AddItemToFront(item=code_block_25, list=dropLastItem@L2)

# group: Control
ofRepeatedItem = List.OfRepeatedItem(item=end_2@@L1, amount=count@L2)
code_block_26 = CodeBlock { 1; }
flatten_2 = List.Flatten(list=ofRepeatedItem, amount=code_block_26)

# group: Processing
# note: Create offset distances for the detail lines
code_block_27 = CodeBlock(count=count) { 0; 1..count; }
slice = List.Slice(list=addItemToFront@L2, start=code_block_27.out0, end=code_block_27.out1@L2)
sum = Math.Sum(values=slice)
code_block_28 = CodeBlock(wdth=sum) { wdth*(-1); }
code_block_29 = CodeBlock(count=code_block_27.out1, tagSpacing=code_block_13.tagSpacing) { (count*tagSpacing*(-1))-tagSpacing; }
# note: location point for the material tags
translate_2 = Geometry.Translate(geometry=code_block_24.start_pts, xTranslation=code_block_28, yTranslation=code_block_29)

# group: Visualisation
code_block_30 = CodeBlock { true; }
# note: Custom Node: GeniusLociv.2023.7.13
create_tag = Custom[Create Tag](view=code_block.active_view, element=flatten_2@L2, TagLocation=translate_2@L2, TagType=code_block_13.materialTag, RunIt=code_block_30)  # package Genius Loci; Works only in Revit 2018 and later. Creates a tag at a given location, of given type and in a supplied view. The node also works with Linked Elements (except space and area), Multi Category tag and Material Tag. Based on an archilab node

# group: Process
code_block_31 = CodeBlock(tg=create_tag) { tg.SetParameterByName("Leader Line", 1); }

# group: Control
end_3 = Revit.Transaction.Transaction.End(input=code_block_31)

# group: Processing
code_block_32 = CodeBlock { 4; }
chop = List.Chop(list=end_3, lengths=code_block_32)
transpose = List.Transpose(lists=chop)
isNull = Object.IsNull(object=transpose@L3)
filterByBoolMask = List.FilterByBoolMask(list=transpose, mask=isNull)

# group: Processing
code_block_33 = CodeBlock(pt=code_block_15.pt) { pt.X; columns = 0..3; (1750*columns)+820; }
add_2 = code_block_33.out0 + code_block_33.out2  # lacing=Longest

# group: Processing
code_block_34 = CodeBlock { 4; }
chop_2 = List.Chop(list=create_tag, lengths=code_block_34)
transpose_2 = List.Transpose(lists=chop_2)
isNull_2 = Object.IsNull(object=transpose_2@L3)
filterByBoolMask_2 = List.FilterByBoolMask(list=transpose_2, mask=isNull_2)
# note: Custom Node: GeniusLociv.2023.7.13
tag_getlocation = Custom[Tag GetLocation](tag=filterByBoolMask_2.out@@L2)  # package Genius Loci; Retrieves the position of the head of tag. Only works in Revit 2017 and later.
code_block_35 = CodeBlock(pt=tag_getlocation) { pt.Y; pt.Z; }
byCoordinates_2 = Point.ByCoordinates(x=add_2@@L1, y=code_block_35.out0@L3, z=code_block_35.out1@L3, lacing=Shortest)

# group: Assing
flatten_3 = List.Flatten(list=filterByBoolMask.out)
flatten_4 = List.Flatten(list=byCoordinates_2)
# note: Custom Node: GeniusLociv.2023.7.13
tag_setlocation = Custom[Tag SetLocation](tag=flatten_3, location=flatten_4)  # package Genius Loci; Moves the head of the tag to the given location point.

code_block_36 = CodeBlock { -400; 300; }
translate_3 = Geometry.Translate(geometry=code_block_17.out1, xTranslation=code_block_36.out0, yTranslation=code_block_36.out1)

# group: Visualisation
# Create "super" tags
code_block_37 = CodeBlock { true; }
# note: Custom Node: GeniusLociv.2023.7.13
create_tag_2 = Custom[Create Tag](view=code_block.active_view, element=end_2, TagLocation=translate_3, TagType=code_block_13.wallTag, RunIt=code_block_37)

# group: Control
# note: Custom Node: SteamNodesv.1.2.4
runMe = Custom[Tool.RunMe](Boolean=code_block_13.withDimensions, ThingToDo=end_2)  # package SteamNodes; Use Boolean to perform an action

# group: Process
# Get the faces and the layers of the new spec wall pieces
faces = Element.Faces(element=end_2)
# note: Custom Node: ACG Toolsv.0.1.1
elements_get_types_2 = Custom[Elements.Get Types](elements=runMe)
elements_compound_structure_2 = Custom[Elements.Compound Structure Layers](elements_type=elements_get_types_2)

# group: Processing
# Create lines for the dimensions. One per spec wall piece.
code_block_38 = CodeBlock { 0; }
pointAtParameter = Surface.PointAtParameter(surface=faces, u=code_block_38, v=code_block_38)
code_block_39 = CodeBlock(pnt=pointAtParameter) { pnt.X; pnt.Y; pnt.Z; }
sort = List.Sort(list=code_block_39.out0@@L2)
firstItem = List.FirstItem(list=sort@L2)
sort_2 = List.Sort(list=code_block_39.out1@@L2)
reverse = List.Reverse(list=sort_2@@L2)
firstItem_2 = List.FirstItem(list=reverse@L2)
sort_3 = List.Sort(list=code_block_39.out2@@L2)
firstItem_3 = List.FirstItem(list=sort_3@L2)
# note: Create detail lines for dimensioning
code_block_40 = CodeBlock(x=firstItem, y=firstItem_2, z=firstItem_3)
# ---------- code_block_40.designscript (5 lines) ----------
start_pts = Point.ByCoordinates(x,y,z);

end_pts = start_pts.Translate(0,75,0);

Line.ByStartPointEndPoint(start_pts,end_pts);
# ----------------------------------------

# group: Control
# Remove ny layers with width 0mm
reverse_2 = List.Reverse(list=elements_compound_structure_2.widths@@L2)
code_block_41 = CodeBlock(value=reverse_2) { value==0?null:value; }
# note: Custom Node: archilab
clear_list_2 = Custom[Clear List](input=code_block_41)

# group: Processing
# Calculate distance from the first detail line per spec wall piece to each layer.
# note: Create offset distances for the detail lines
count_2 = List.Count(list=clear_list_2@@L2)
code_block_42 = CodeBlock(count=count_2) { 0; 1..count; }
slice_2 = List.Slice(list=clear_list_2@L2, start=code_block_42.out0, end=code_block_42.out1@L2)
sum_2 = Math.Sum(values=slice_2)

# group: Processing
# Put together all lines required to dimension the layers of all spec wall pieces.
translate_4 = Geometry.Translate(geometry=code_block_40.out2, xTranslation=sum_2)
# note: duplicate the lines
addItemToFront_2 = List.AddItemToFront(item=code_block_40.out2@@L1, list=translate_4@L2)

# group: Python | Important
# Create all detail curves and dimensions
current = Document.Current()
activeView = Document.ActiveView(document=current)
# note: create the actual detail lines
byCurve = DetailCurve.ByCurve(view=activeView, curve=addItemToFront_2)
byElements = Dimension.ByElements(view=activeView, referenceElements=byCurve)

# group: Control
code_block_43 = CodeBlock { "Views - Generate Spec Views - Walls"; }
# note: Custom Node: ACG Toolsv.0.1.1
data_script_use_log = Custom[Data.Script Use Log](script_name=code_block_43)  # package ACG Tools; Adds an entry to TXT document every time a script is run. The document is located in R:\Dynamo\05-UsageStats

# group: Python | Important
# Apply phase created (Library) and phase demolished (Existing) to all walls
# note: IN = processed walls
# OUT = failed walls
python_script_4 = Python(IN[0]=end_2)  # CPython3
# ---------- python_script_4.python (54 lines) ----------
import clr
import sys
sys.path.append('C:\Program Files (x86)\IronPython 2.7\Lib')
import System
from System import Array
from System.Collections.Generic import *
clr.AddReference('ProtoGeometry')
from Autodesk.DesignScript.Geometry import *
clr.AddReference("RevitNodes")
import Revit
clr.ImportExtensions(Revit.Elements)
clr.ImportExtensions(Revit.GeometryConversion)
clr.AddReference("RevitServices")
import RevitServices
from RevitServices.Persistence import DocumentManager 
from RevitServices.Transactions import TransactionManager 

clr.AddReference("RevitAPI")
clr.AddReference("RevitAPIUI")

import Autodesk 
from Autodesk.Revit.DB import *
from Autodesk.Revit.UI import *

doc = DocumentManager.Instance.CurrentDBDocument
uiapp = DocumentManager.Instance.CurrentUIApplication 
app = uiapp.Application 
uidoc = uiapp.ActiveUIDocument

#######OK NOW YOU CAN CODE########

walls = UnwrapElement(IN[0])

phases = FilteredElementCollector(doc)\
.OfCategory(BuiltInCategory.OST_Phases)\
.ToElements()

for p in phases:
    if "Existing" in p.Name:
        exst_ph = p
    elif "Library" in p.Name:
        lib_ph = p

processed_walls, failed_walls = [], []
for w in walls:
    try:
        w.get_Parameter(BuiltInParameter.PHASE_CREATED).Set(lib_ph.Id)
        w.get_Parameter(BuiltInParameter.PHASE_DEMOLISHED).Set(exst_ph.Id)
        processed_walls.append(w)
    except:
        failed_walls.append(w)
        continue

OUT = processed_walls, failed_walls
# ----------------------------------------

# group: Python | Important
count_3 = List.Count(list=clear_list@L2)
code_block_44 = CodeBlock(cnt=count_3) { cnt-1; }
removeItemAtIndex = List.RemoveItemAtIndex(list=clear_list@L2, indices=code_block_44)
